# Grasshopper definition 00_hello_world.gh (Grasshopper 1.0.8)

# ---- group: Starting point for exercises
python_3_script = Python3Script()  # -> out, a
# ---------- python_3_script: Python ----------
# r: compas
# venv: mas-2526

# NOTE: You can delete the following lines
# and start clean on every exercise
from compas.geometry import Box
a = Box(10, 5, 3)
# ---------- end python_3_script ----------

# ---- group: To visualize COMPAS geometry
compas_draw = COMPASDraw(cg=python_3_script.a)  # -> rg
#   port cg: The COMPAS geometry or datastructure to be drawn.
#   port rg: The Rhino geometry object.
# ---------- compas_draw: Python ----------
# r: compas>=2.14.1
"""
Draws COMPAS geometry in Grasshopper.
"""

from typing import Any

import Grasshopper

from compas.scene import SceneObject


class CompasToRhinoGeometry(Grasshopper.Kernel.GH_ScriptInstance):
    def RunScript(self, cg):
        if not cg:
            return None

        return SceneObject(item=cg).draw()
# ---------- end compas_draw ----------
