# Grasshopper definition 02-grasshopper-python-basics-iii_hs25.gh (Grasshopper 1.0.8)

# ----
# Different ways of defining INPUT
# Tip: use control+alt+left click on
# any component to see where it comes from!
# Fixed values
integer = Integer(42)
panel = Panel(integer)

float = Number(3.14)
panel_2 = Panel(float)

panel_3 = Panel("Hello World")

# ----
# Referenced geometry
# Internalized geometry
point = Point(<point referenced from the Rhino model>)
panel_4 = Panel(point)

# ----
# Tip: use "bake" to create geometry in Rhino
point_2 = Point(Point(0.5, 3, 0))
panel_5 = Panel(point_2)

boolean = Boolean(True)
panel_6 = Panel(boolean)

# ---- group: Variable values
integers = Slider(42, range=0..50)
panel_7 = Panel(integers)

panel_8 = Panel(Toggle(True))

floats = Slider(3.14, range=0..10)
panel_9 = Panel(floats)

# ----
# Constructed geometry
integers_2 = Slider(9, range=0..50)
integers_3 = Slider(8, range=0..50)
integers_4 = Slider(5, range=0..50)
pt = ConstructPoint(XCoordinate=integers_2, YCoordinate=integers_3, ZCoordinate=integers_4)
panel_10 = Panel(pt)

# ----
# Explicitely defined lists
integers_5 = Slider(3, range=0..50)
integers_6 = Slider(4, range=0..50)
integers_7 = Slider(5, range=0..50)
# Tip: hold shift while connecting wires to append
# the wire, conversely, hold control to disconnect.
integers_8 = Slider(6, range=0..50)
data = Data([integers_5, integers_8, integers_6, integers_7])
panel_11 = Panel(data)

# ----
# Computed lists
number_slider = Slider(3, range=0..100)
series = Series(Start=number_slider, Step=1, Count=Slider(4, range=0..100))
panel_12 = Panel(series)

# ----
# List of geometries
series_2 = Series(Start=0, Step=1, Count=10)
integers_9 = Slider(9, range=0..50)
integers_10 = Slider(2, range=0..50)
pt_2 = ConstructPoint(XCoordinate=series_2, YCoordinate=integers_9, ZCoordinate=integers_10)
panel_13 = Panel(pt_2)

integers_11 = Slider(42, range=0..50)
# Different ways of dealing with INPUT in the PROCESS
# Tip: right-click the name of an input
# to select access type (item, list, or tree)
# One item, processed one-by-one
integers_12 = Slider(42, range=0..50)
python_3_script = Python3Script(x=integers_12, y=integers_11)  # -> out, a
# ---------- python_3_script: Python ----------
print(x + y)
# ---------- end python_3_script ----------
panel_14 = Panel(python_3_script.out)

integers_13 = Slider(6, range=0..50)
# Many items, processed one-by-one
integers_14 = Slider(3, range=0..50)
integers_15 = Slider(4, range=0..50)
integers_16 = Slider(5, range=0..50)
data_2 = Data([integers_14, integers_15, integers_16, integers_13])
python_3_script_2 = Python3Script(x=data_2)  # -> out, a
# ---------- python_3_script_2: Python ----------
print(x ** 2)
# ---------- end python_3_script_2 ----------
panel_15 = Panel(python_3_script_2.out)

# ----
# Conditional process
# Iterative process
integers_17 = Slider(24, range=-50..50)
script = Script(value=integers_17)  # -> out, a
# ---------- script: Python ----------
if value > 0:
    print("Value is positive")
elif value < 0:
    print("Value is negative")
else:
    print("Value is zero")
# ---------- end script ----------
panel_16 = Panel(script.out)

integers_18 = Slider(10, range=0..20)
python_3_script_3 = Python3Script(x=integers_18)  # -> out, a; inputs x: Int32
# ---------- python_3_script_3: Python ----------
for i in range(x):
    print(i)
# ---------- end python_3_script_3 ----------
panel_17 = Panel(python_3_script_3.out)

# ----
# Basic ways of defining PROCESS
# Simple sequential process, print output
python_3_script_4 = Python3Script()  # -> out, a
# ---------- python_3_script_4: Python ----------
print(0)
print(1)
print(2)
print(3)
print(4)
# ---------- end python_3_script_4 ----------
panel_18 = Panel(python_3_script_4.out)

# ----
# Simple sequential process, assign output to param
script_2 = Script()  # -> out, a
# ---------- script_2: Python ----------
a = []
a.append(0)
a.append(1)
a.append(1)
a.append(2)
a.append(3)
a.append(4)
# ---------- end script_2 ----------
panel_19 = Panel(script_2.a)

# ----
# 2D list of points with modulo filter
number_slider_2 = Slider(10, range=0..20)

# ----
# 2D list of points, simple
number_slider_3 = Slider(10, range=0..20)

center_of_grid = Point(Point(20, 0, 0))
python_3_script_5 = Python3Script(center=center_of_grid, nx=number_slider_2, ny=Slider(10, range=0..20))  # -> out, a; inputs center: Point3d, nx: Int32, ny: Int32
# ---------- python_3_script_5: Python ----------
# r: compas
# venv: mas-2526

import math
from random import choice
from compas.geometry import Point


def modulo_filter(x, y):
    result = (x + y) % 2 == 0
    return result
    
a = []

for ix in range(nx):
    for iy in range(ny):
        if modulo_filter(ix, iy):
            x = (center.X - nx / 2) + ix
            y = (center.Y - ny / 2) + iy

            point = Point(x, y, 0)
            a.append(point)
# ---------- end python_3_script_5 ----------
compas_draw = COMPASDraw(cg=python_3_script_5.a)  # -> rg
#   port cg: The COMPAS geometry or datastructure to be drawn.
#   port rg: The Rhino geometry object.
# ---------- compas_draw: Python ----------
# r: compas>=2.14.1
"""
Draws COMPAS geometry in Grasshopper.
"""

from typing import Any

import Grasshopper

from compas.scene import SceneObject


class CompasToRhinoGeometry(Grasshopper.Kernel.GH_ScriptInstance):
    def RunScript(self, cg):
        if not cg:
            return None

        return SceneObject(item=cg).draw()
# ---------- end compas_draw ----------

# ----
# Combining it all to create a 2d list OUTPUT
center_of_grid_2 = Point(Point(0, 0, 0))
python_3_script_6 = Python3Script(center=center_of_grid_2, nx=number_slider_3, ny=Slider(10, range=0..20))  # -> out, a; inputs center: Point3d, nx: Int32, ny: Int32
# ---------- python_3_script_6: Python ----------
# r: compas
# venv: mas-2526

from compas.geometry import Point

a = []

for ix in range(nx):
    for iy in range(ny):
        x = (center.X - nx / 2) + ix
        y = (center.Y - ny / 2) + iy
        point = Point(x, y, 0)
        a.append(point)
# ---------- end python_3_script_6 ----------
compas_draw_2 = COMPASDraw(cg=python_3_script_6.a)  # -> rg; same code as compas_draw

# ----
# 2D list of points with random filter
number_slider_4 = Slider(10, range=0..20)

center_of_grid_3 = Point(Point(40, 0, 0))
python_3_script_7 = Python3Script(center=center_of_grid_3, nx=number_slider_4, ny=Slider(10, range=0..20))  # -> out, a; inputs center: Point3d, nx: Int32, ny: Int32
# ---------- python_3_script_7: Python ----------
# r: compas
# venv: mas-2526

from random import choice
from compas.geometry import Point


def random_filter():
    result = choice([True, False])
    return result

a = []

for ix in range(nx):
    for iy in range(ny):
        if random_filter():
            x = (center.X - nx / 2) + ix
            y = (center.Y - ny / 2) + iy

            point = Point(x, y, 0)
            a.append(point)
# ---------- end python_3_script_7 ----------
compas_draw_3 = COMPASDraw(cg=python_3_script_7.a)  # -> rg; same code as compas_draw

# ----
# 2D list of points with circle filter
number_slider_5 = Slider(10, range=0..20)

radius = Slider(4, range=0..20)

center_of_grid_4 = Point(Point(60, 0, 0))
python_3_script_8 = Python3Script(center=center_of_grid_4, nx=number_slider_5, ny=Slider(10, range=0..20), radius=radius)  # -> out, a; inputs center: Point3d, nx: Int32, ny: Int32
# ---------- python_3_script_8: Python ----------
# r: compas
# venv: mas-2526

import math
from compas.geometry import Point

def circle_distance_filter(x, y, center, radius):
    distance = math.sqrt((center.X - x)**2 + (center.Y - y)**2)
    return radius >= distance

a = []

for ix in range(nx):
    for iy in range(ny):
        x = (center.X - nx / 2) + ix
        y = (center.Y - ny / 2) + iy 
        if circle_distance_filter(x, y, center, radius):
            point = Point(x, y, 0)
            a.append(point)
# ---------- end python_3_script_8 ----------
compas_draw_4 = COMPASDraw(cg=python_3_script_8.a)  # -> rg; same code as compas_draw

integers_19 = Slider(6, range=0..50)
# Many items, processed as a list
integers_20 = Slider(3, range=0..50)
integers_21 = Slider(4, range=0..50)
integers_22 = Slider(5, range=0..50)
data_3 = Data([integers_20, integers_21, integers_22, integers_19])

python_3_script_9 = Python3Script(x=data_3)  # -> out, a; inputs x: list
# ---------- python_3_script_9: Python ----------
for i in x:
    print(i ** 2)
# ---------- end python_3_script_9 ----------

panel_20 = Panel(python_3_script_9.out)
