# Grasshopper definition 03-3d-grids-and-filters_hs25.gh (Grasshopper 1.0.8)

# ----
# Working with geometric types
# Minimal Box Constructor
size = Slider(6, range=0..10)
python = Python3Script(size=size)  # -> box; inputs size: Double
# ---------- python: Python ----------
# r: compas
# venv: mas-2526

from compas.geometry import Box

# Create a box with matching x, y and z sizes based on a single value
box = Box(size)
print(box.xsize)
print(box.ysize)
print(box.zsize)
# ---------- end python ----------
draw = Python3Script(cg=python)  # -> rg
#   port cg: The COMPAS geometry or datastructure to be drawn.
# ---------- draw: Python ----------
# r: compas
# venv: mas-2526

from compas.geometry import Point, Box
from compas_rhino.conversions import point_to_rhino, box_to_rhino

rg = None
if cg:
    if isinstance(cg, Point):
        rg = point_to_rhino(cg)
    elif isinstance(cg, Box):
        rg = box_to_rhino(cg)
# ---------- end draw ----------

# ----
# Constructors
ysize = Slider(5, range=0..10)
zsize = Slider(2, range=0..10)

# ----
# Basic Box Constructor
xsize = Slider(4, range=0..10)
pt = Point(Point(20, 0, 0))
python_2 = Python3Script(center=pt, xsize=xsize, ysize=ysize, zsize=zsize)  # -> box; inputs center: Point3d, xsize: Double
# ---------- python_2: Python ----------
# r: compas
# venv: mas-2526

from compas.geometry import Box

# Create a box with custom dimensions
box = Box(xsize, ysize, zsize)

# Assign the center of its frame
box.frame.point = center
# ---------- end python_2 ----------
draw_2 = Python3Script(cg=python_2)  # -> rg; same code as draw

# ----
# Box.from_width_height_depth
width = Slider(4, range=0..10)
height = Slider(5, range=0..10)
depth = Slider(2, range=0..10)
pt_2 = Point(Point(40, 0, 0))
python_3 = Python3Script(center=pt_2, width=width, height=height, depth=depth)  # -> box; inputs center: Point3d, width: Double, height: Double, depth: Double
# ---------- python_3: Python ----------
# r: compas
# venv: mas-2526

from compas.geometry import Box

# Create a box from width, height, and depth
box = Box.from_width_height_depth(width, height, depth)

# Assign the center of its frame
box.frame.point = center
# ---------- end python_3 ----------
draw_3 = Python3Script(cg=python_3)  # -> rg; same code as draw

# ----
# Box.from_corner_corner_height
height_2 = Slider(6, range=0..10)
pt_3 = Point(Point(60, 0, 0))
pt_4 = Point(Point(66, 4.31834208, 0))
python_4 = Python3Script(corner1=pt_3, corner2=pt_4, height=height_2)  # -> box; inputs corner1: Point3d, corner2: Point3d, height: Double
# ---------- python_4: Python ----------
# r: compas
# venv: mas-2526

# -----------------------------------------
# ------ Box from Corner and Height -------

from compas.geometry import Point, Box

# Create a box from opposite corners of its base and its height

"""
# You can always hard-code your parameters

corner1 = Point(0, 0, 0)
corner2 = Point(1, 1, 0)
height = 2
"""


box = Box.from_corner_corner_height(corner1, corner2, height)

print(box.xsize)  # Output: 1.0
print(box.ysize)  # Output: 1.0
print(box.zsize)  # Output: 2.0
# ---------- end python_4 ----------
draw_4 = Python3Script(cg=python_4)  # -> rg; same code as draw

# ----
# Oriented box
pt_5 = Point(Point(0, -20, 0))
xsize_2 = Slider(4, range=0..10)
ysize_2 = Slider(5, range=0..10)
zsize_2 = Slider(2, range=0..10)
python_5 = Python3Script(center=pt_5, xaxis=".5,.5,0", yaxis="0,.5,.5", xsize=xsize_2, ysize=ysize_2, zsize=zsize_2)  # -> box; inputs center: Point3d, xaxis: Vector3d, yaxis: Vector3d, xsize: Double, ysize: Double, zsize: Double
# ---------- python_5: Python ----------
# r: compas
# venv: mas-2526

from compas.geometry import Box
from compas.geometry import Frame

frame = Frame(center, xaxis, yaxis)

# Create a box from width, height, and depth
box = Box(xsize, ysize, zsize, frame)
# ---------- end python_5 ----------
draw_5 = Python3Script(cg=python_5)  # -> rg; same code as draw

# ----
# Methods
size_2 = Slider(5, range=0..10)
pt_6 = Point(Point(80, 0, 0))
pt_7 = Point(Point(81.06491735, 0, 0))
ghpython_script = Python3Script(center=pt_6, point=pt_7, size=size_2)  # -> out, box; inputs center: Point3d, point: Point3d
# ---------- ghpython_script: Python ----------
# r: compas
# venv: mas-2526

from compas.geometry import Box

box = Box(size)
box.frame.point = center

print(box.contains_point(point))
# ---------- end ghpython_script ----------
panel = Panel(ghpython_script.out)
draw_6 = Python3Script(cg=ghpython_script.box)  # -> rg; same code as draw

xsize_3 = Slider(4, range=0..10)
ysize_3 = Slider(6, range=0..10)
zsize_3 = Slider(6, range=0..10)
pt_8 = Point(Point(120, 0, 0))
python_6 = Python3Script(center=pt_8, xsize=xsize_3, ysize=ysize_3, zsize=zsize_3)  # -> box; inputs center: Point3d, xsize: Double; same code as python_2
ghpython_script_2 = Python3Script(box=python_6, angle=Slider(-1.847, range=-6.283..6.283), axis="0,0,1")  # -> a; inputs axis: Vector3d
# ---------- ghpython_script_2: Python ----------
# r: compas
# venv: mas-2526

from compas.geometry import Box

# First copy, then rotate the copy
a = box.copy()
a.rotate(angle, axis=axis, point=box.frame.point)
# ---------- end ghpython_script_2 ----------
draw_7 = Python3Script(cg=ghpython_script_2)  # -> rg; same code as draw

xsize_4 = Slider(4, range=0..10)
ysize_4 = Slider(6, range=0..10)
zsize_4 = Slider(6, range=0..10)
pt_9 = Point(Point(140, 0, 0))
python_7 = Python3Script(center=pt_9, xsize=xsize_4, ysize=ysize_4, zsize=zsize_4)  # -> box; inputs center: Point3d, xsize: Double; same code as python_2
ghpython_script_3 = Python3Script(box=python_7, factor=Slider(1.313, range=0..5))  # -> a
# ---------- ghpython_script_3: Python ----------
# r: compas
# venv: mas-2526

from compas.geometry import Box

# First copy, then rotate the copy
a = box.copy()
a.scale(factor)
# ---------- end ghpython_script_3 ----------
draw_8 = Python3Script(cg=ghpython_script_3)  # -> rg; same code as draw

xsize_5 = Slider(4, range=0..10)
ysize_5 = Slider(6, range=0..10)
zsize_5 = Slider(6, range=0..10)
pt_10 = Point(Point(160, 0, 0))
python_8 = Python3Script(center=pt_10, xsize=xsize_5, ysize=ysize_5, zsize=zsize_5)  # -> box; inputs center: Point3d, xsize: Double; same code as python_2
ghpython_script_4 = Python3Script(box=python_8, xmove=Slider(1.62, range=-10..10), ymove=Slider(-4.79, range=-10..10), zmove=Slider(3.685, range=-10..10))  # -> a
# ---------- ghpython_script_4: Python ----------
# r: compas
# venv: mas-2526

from compas.geometry import Box
from compas.geometry import Translation

# First copy, then transform the copy with a translation
a = box.copy()
motion_vector = (xmove, ymove, zmove)
a.transform(Translation.from_vector(motion_vector))
# ---------- end ghpython_script_4 ----------
draw_9 = Python3Script(cg=ghpython_script_4)  # -> rg; same code as draw

# ----
# Attributes
ghpython_script_5 = Python3Script(box=python_5)  # -> xsize, ysize, zsize, volume, area, xmin, xmax, ymin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
# ---------- ghpython_script_5: Python ----------
# r: compas
# venv: mas-2526

xsize = box.xsize
ysize = box.ysize
zsize = box.zsize
volume = box.volume
area = box.area
xmin = box.xmin
xmax = box.xmax
ymin = box.ymin
ymax = box.ymax
zmin = box.zmin
zmax = box.zmax
# ---------- end ghpython_script_5 ----------
panel_2 = Panel(ghpython_script_5.xsize)
panel_3 = Panel(ghpython_script_5.ysize)
panel_4 = Panel(ghpython_script_5.zsize)
panel_5 = Panel(ghpython_script_5.volume)
panel_6 = Panel(ghpython_script_5.area)
panel_7 = Panel(ghpython_script_5.xmin)
panel_8 = Panel(ghpython_script_5.xmax)
panel_9 = Panel(ghpython_script_5.ymin)
panel_10 = Panel(ghpython_script_5.ymax)
panel_11 = Panel(ghpython_script_5.zmin)
panel_12 = Panel(ghpython_script_5.zmax)

angle = Slider(0.104, range=-6.283..6.283)
pt_11 = Point(Point(100, 0, 0))
ghpython_script_6 = Python3Script(center=pt_11, angle=angle, axis="1,0,0")  # -> a; inputs center: Point3d, axis: Vector3d
# ---------- ghpython_script_6: Python ----------
# r: compas
# venv: mas-2526

from compas.geometry import Box

box = Box(3, 5, 4)
box.frame.point = center

# Rotate while creating a copy
a = box.rotated(angle, axis=axis, point=box.frame.point)
# ---------- end ghpython_script_6 ----------
draw_10 = Python3Script(cg=ghpython_script_6)  # -> rg; same code as draw

# ----
# 3d grids
# Geometric filters
# Mathematical Equations
coefficient = Slider(1, range=0..2)
# 3D point grid with linear filter (two planes)
threshold = Slider(12.32, range=0..100)
coefficient_2 = Slider(1, range=0..2)

nz = Slider(10, range=0..20)
# 3D point grid with linear filter
number_slider = Slider(10, range=0..20)
coefficient_3 = Slider(1, range=0..2)
center_of_grid = Point(Point(120, 20, 0))
python_9 = Python3Script(
    center=center_of_grid,
    nx=number_slider,
    ny=Slider(10, range=0..20),
    nz=nz,
    coefficient_x=coefficient_3,
    coefficient_y=coefficient_2,
    coefficient_z=coefficient,
    threshold=threshold)  # -> out, a; inputs center: Point3d, nx: Int32, ny: Int32, nz: Int32
# ---------- python_9: Python ----------
# r: compas
# venv: mas-2526

import math
from compas.geometry import Point, Box

def linear_filter(x, y, z, coefficient_x, coefficient_y, coefficient_z, threshold):
    return coefficient_x*x + coefficient_y*y + coefficient_z*z < threshold

a = []

# Iterate over a 3D grid
for ix in range(nx):
    for iy in range(ny):
        for iz in range(nz):
            x = (center.X - nx / 2) + ix
            y = (center.Y - ny / 2) + iy 
            z = (center.Z - nz / 2) + iz
            if linear_filter(ix, iy, iz, coefficient_x, coefficient_y, coefficient_z, threshold):
                point = Point(x, y, z)
                box = Box(1)
                box.frame.point = point
                a.append(box)
# ---------- end python_9 ----------
draw_11 = Python3Script(cg=python_9.a)  # -> rg; same code as draw

horizontal_shift_y = Slider(0, range=-20..20)
nz_2 = Slider(10, range=0..20)
coefficient_4 = Slider(1.6, range=0..2)
center_of_grid_2 = Point(Point(140, 20, 0))
python_10 = Python3Script(
    center=center_of_grid_2,
    nx=Slider(10, range=0..20),
    ny=Slider(10, range=0..20),
    nz=nz_2,
    coefficient=coefficient_4,
    vertical_shift_x=Slider(0, range=-20..20),
    vertical_shift_y=Slider(0, range=-20..20),
    horizontal_shift_x=Slider(0, range=-20..20),
    horizontal_shift_y=horizontal_shift_y)  # -> out, a; inputs center: Point3d, nx: Int32, ny: Int32, nz: Int32
# ---------- python_10: Python ----------
# r: compas
# venv: mas-2526

import math
from compas.geometry import Point, Box

# Linear filter function
def linear_filter(x, y, z, coefficient=1, vertical_shift_x=0, vertical_shift_y=0, horizontal_shift_x=0, horizontal_shift_y=0):
    z_range_x = (coefficient * x + vertical_shift_x) + horizontal_shift_x
    z_range_y = (coefficient * y + vertical_shift_y) + horizontal_shift_y
    
    return z < z_range_x or z < z_range_y  

a = []

# Iterate over a 3D grid
for ix in range(nx):
    for iy in range(ny):
        for iz in range(nz):
            x = (center.X - nx / 2) + ix
            y = (center.Y - ny / 2) + iy 
            z = (center.Z - nz / 2) + iz
            # Apply the linear filter
            if linear_filter(ix, iy, iz, coefficient, vertical_shift_x, vertical_shift_y, horizontal_shift_x, horizontal_shift_y):
                point = Point(x, y, z)
                box = Box(1)
                box.frame.point = point
                a.append(box)
# ---------- end python_10 ----------
draw_12 = Python3Script(cg=python_10.a)  # -> rg; same code as draw

horizontal_shift_x = Slider(1, range=-20..20)
horizontal_shift_y_2 = Slider(1, range=-20..20)

# ----
# 3D point grid with paraboloid filter
vertical_shift_y = Slider(-4, range=-20..20)
vertical_shift_x = Slider(-4, range=-20..20)
nz_3 = Slider(10, range=0..20)
coefficient_5 = Slider(0.25, range=0..5)
center_of_grid_3 = Point(Point(160, 20, 0))
python_11 = Python3Script(
    center=center_of_grid_3,
    nx=Slider(10, range=0..20),
    ny=Slider(10, range=0..20),
    nz=nz_3,
    coefficient=coefficient_5,
    vertical_shift_x=vertical_shift_x,
    vertical_shift_y=vertical_shift_y,
    horizontal_shift_x=horizontal_shift_x,
    horizontal_shift_y=horizontal_shift_y_2)  # -> out, a; inputs center: Point3d, nx: Int32, ny: Int32, nz: Int32
# ---------- python_11: Python ----------
# r: compas
# venv: mas-2526

import math
from compas.geometry import Point, Box

# Paraboloid filter function
def paraboloid_filter(x, y, z, coefficient, horizontal_shift_x, horizontal_shift_y, vertical_shift_x, vertical_shift_y):
    z_paraboloid_x = (coefficient * ((x + vertical_shift_x) ** 2 + (y + vertical_shift_y) ** 2)) + horizontal_shift_x
    z_paraboloid_y = (coefficient * ((y + vertical_shift_x) ** 2 + (x + vertical_shift_x) ** 2)) + horizontal_shift_y

    # Check if the z value of the point is less than or equal to the z value of the paraboloid
    return z_paraboloid_x > z < z_paraboloid_y


a = []

# Iterate over a 3D grid
for ix in range(nx):
    for iy in range(ny):
        for iz in range(nz):
            x = (center.X - nx / 2) + ix
            y = (center.Y - ny / 2) + iy 
            z = (center.Z - nz / 2) + iz
            # Apply the paraboloid filter
            if paraboloid_filter(ix, iy, iz, coefficient, horizontal_shift_x, horizontal_shift_y, vertical_shift_x, vertical_shift_y):
                point = Point(x, y, z)
                box = Box(1)
                box.frame.point = point
                a.append(box)
# ---------- end python_11 ----------
draw_13 = Python3Script(cg=python_11.a)  # -> rg; same code as draw

# ----
# Exploration
# Helix
number_slider_2 = Slider(1.16, range=0..3)
center = Point(Point(0, 40, 0))
ghpython_script_7 = Python3Script(
    center=center,
    radius=number_slider_2,
    pitch=Slider(1.85, range=1..10),
    turns=Slider(14, range=10..50),
    num_segments=Slider(20, range=10..50))  # -> out, points, boxes; inputs center: Point3d, turns: Int32, num_segments: Int32
# ---------- ghpython_script_7: Python ----------
# r: compas
# venv: mas-2526

import math
from compas.geometry import Box
from compas.geometry import Frame
from compas.geometry import Point
from compas.geometry import Vector


# Generate helix points
points = []
tangents = []
total_segments = turns * num_segments

for i in range(total_segments):
    angle = 2 * math.pi * i / num_segments
    z = pitch * i / num_segments
    x1 = radius * math.cos(angle)
    y1 = radius * math.sin(angle)

    dx1 = -radius * math.sin(angle)
    dy1 = radius * math.cos(angle)
    dz = pitch / num_segments

    tangent1 = Vector(dx1, dy1, dz)
    tangent1.unitize()

    points.append(Point(x1 + center.X, y1 + center.Y, z + center.Z))
    tangents.append(tangent1)

# Create boxes
boxes = []
for point, xaxis in zip(points, tangents):
    zaxis = Vector(0, 0, 1)
    yaxis = zaxis.cross(xaxis) # Orthogonal vector for Y-axis
    yaxis.unitize()
    
    frame = Frame(point, xaxis, yaxis)
    
    # Create the box at the point with the specified frame
    box = Box(.2, .2, .2)
    box.frame = frame
    boxes.append(box)
# ---------- end ghpython_script_7 ----------
draw_14 = Python3Script(cg=ghpython_script_7.boxes)  # -> rg; same code as draw

# ----
# 3D point grid, simple
number_slider_3 = Slider(10, range=0..20)
nz_4 = Slider(10, range=0..20)

# ----
# 3D box grid, simple
number_slider_4 = Slider(10, range=0..20)
nz_5 = Slider(10, range=0..20)

# ----
# 3D box grid with modulo filter
number_slider_5 = Slider(10, range=0..20)
nz_6 = Slider(10, range=0..20)

# ----
# 3D box grid with random filter
number_slider_6 = Slider(10, range=0..20)
nz_7 = Slider(10, range=0..20)

# ----
# 3D box grid with sphere filter
number_slider_7 = Slider(10, range=0..20)
nz_8 = Slider(10, range=0..20)

radius = Slider(2, range=0..20)
center_of_grid_4 = Point(Point(80, 20, 0))

python_12 = Python3Script(center=center_of_grid_4, nx=number_slider_7, ny=Slider(10, range=0..20), nz=nz_8, radius=radius)  # -> out, a; inputs center: Point3d, nx: Int32, ny: Int32, nz: Int32
# ---------- python_12: Python ----------
# r: compas
# venv: mas-2526

import math
from compas.geometry import Point, Box

def sphere_distance_filter(x, y, z, center, radius):
    distance = math.sqrt((center.X - x)**2 + (center.Y - y)**2 + (center.Z - z)**2)
    return radius >= distance

a = []

for ix in range(nx):
    for iy in range(ny):
        for iz in range(nz):
            x = (center.X - nx / 2) + ix
            y = (center.Y - ny / 2) + iy 
            z = (center.Z - nz / 2) + iz
            if sphere_distance_filter(x, y, z, center, radius):
                point = Point(x, y, z)
                box = Box(.9)
                box.frame.point = point
                a.append(box)
# ---------- end python_12 ----------

draw_15 = Python3Script(cg=python_12.a)  # -> rg; same code as draw

# ----
# 3D box grid with rhino geometry filter
number_slider_8 = Slider(10, range=0..20)
nz_9 = Slider(10, range=0..20)

center_of_grid_5 = Point(Point(40, 20, 0))

python_13 = Python3Script(center=center_of_grid_5, nx=number_slider_5, ny=Slider(10, range=0..20), nz=nz_6)  # -> out, a; inputs center: Point3d, nx: Int32, ny: Int32, nz: Int32
# ---------- python_13: Python ----------
# r: compas
# venv: mas-2526

import math
from random import choice
from compas.geometry import Point, Box


def modulo_filter(x, y, z):
    result = (x + y + z) % 2 == 0
    return result
    
a = []

for ix in range(nx):
    for iy in range(ny):
        for iz in range(nz):
            if modulo_filter(ix, iy, iz):
                x = (center.X - nx / 2) + ix
                y = (center.Y - ny / 2) + iy
                z = (center.Z - nz / 2) + iz

                point = Point(x, y, z)
                box = Box(.9)
                box.frame.point = point
                a.append(box)
# ---------- end python_13 ----------

draw_16 = Python3Script(cg=python_13.a)  # -> rg; same code as draw

center_of_grid_6 = Point(Point(60, 20, 0))

python_14 = Python3Script(center=center_of_grid_6, nx=number_slider_6, ny=Slider(10, range=0..20), nz=nz_7)  # -> out, a; inputs center: Point3d, nx: Int32, ny: Int32, nz: Int32
# ---------- python_14: Python ----------
# r: compas
# venv: mas-2526

from random import choice
from compas.geometry import Point, Box


def random_filter():
    result = choice([True, False])
    return result

a = []

for ix in range(nx):
    for iy in range(ny):
        for iz in range(nz):
            if random_filter():
                x = (center.X - nx / 2) + ix
                y = (center.Y - ny / 2) + iy
                z = (center.Z - nz / 2) + iz
                point = Point(x, y, z)
                box = Box(.9)
                box.frame.point = point
                a.append(box)
# ---------- end python_14 ----------

draw_17 = Python3Script(cg=python_14.a)  # -> rg; same code as draw

center_of_grid_7 = Point(Point(100, 20, 0))
geometry = Geometry(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)

python_15 = Python3Script(center=center_of_grid_7, nx=number_slider_8, ny=Slider(10, range=0..20), nz=nz_9, rhino_box=geometry)  # -> out, a; inputs center: Point3d, nx: Int32, ny: Int32, nz: Int32, rhino_box: Box
# ---------- python_15: Python ----------
# r: compas
# venv: mas-2526

import math
from compas.geometry import Point, Box, Sphere
from compas_rhino.conversions import box_to_compas
filter_box = box_to_compas(rhino_box)

a = []

for ix in range(nx):
    for iy in range(ny):
        for iz in range(nz):
            x = (center.X - nx / 2) + ix
            y = (center.Y - ny / 2) + iy 
            z = (center.Z - nz / 2) + iz
            if filter_box.contains_point((x, y, z)):
                point = Point(x, y, z)
                box = Box(.9)
                box.frame.point = point
                a.append(box)
# ---------- end python_15 ----------

draw_18 = Python3Script(cg=python_15.a)  # -> rg; same code as draw

center_of_grid_8 = Point(Point(0, 20, 0))

python_16 = Python3Script(center=center_of_grid_8, nx=Slider(10, range=0..20), ny=number_slider_3, nz=nz_4)  # -> out, a; inputs center: Point3d, nx: Int32, ny: Int32, nz: Int32
# ---------- python_16: Python ----------
# r: compas
# venv: mas-2526

from compas.geometry import Point

a = []

for ix in range(nx):
    for iy in range(ny):
        for iz in range(nz):
            x = (center.X - nx / 2) + ix
            y = (center.Y - ny / 2) + iy
            z = (center.Z - nz / 2) + iz
            point = Point(x, y, z)
            a.append(point)
# ---------- end python_16 ----------

draw_19 = Python3Script(cg=python_16.a)  # -> rg; same code as draw

center_of_grid_9 = Point(Point(20, 20, 0))

python_17 = Python3Script(center=center_of_grid_9, nx=number_slider_4, ny=Slider(10, range=0..20), nz=nz_5)  # -> out, a; inputs center: Point3d, nx: Int32, ny: Int32, nz: Int32
# ---------- python_17: Python ----------
# r: compas
# venv: mas-2526

from compas.geometry import Point, Box

a = []

for ix in range(nx):
    for iy in range(ny):
        for iz in range(nz):
            x = (center.X - nx / 2) + ix
            y = (center.Y - ny / 2) + iy
            z = (center.Z - nz / 2) + iz
            point = Point(x, y, z)
            box = Box(.9)
            box.frame.point = point
            a.append(box)
# ---------- end python_17 ----------

draw_20 = Python3Script(cg=python_17.a)  # -> rg; same code as draw
