# Grasshopper definition assignment_table_solution.ghx (Grasshopper 1.0.8)

construct_point = ConstructPoint(XCoordinate=Slider(5, range=0..10), YCoordinate=Slider(4, range=0..10), ZCoordinate=Slider(20, range=0..20))
xy_plane = XYPlane(Origin=construct_point)
python_3_script = Python3Script(radius=Slider(13, range=0..100), pl=xy_plane)  # -> out, a, geom, geom_2; inputs radius: Double, pl: Plane
# ---------- python_3_script: Python ----------
# r: compas
# venv: mas-2526

import math
from compas.geometry import Box, Frame, Translation, Vector, Brep, Sphere

class Table:
    def __init__(self, length, width, height, leg_size, thickness=1):
        self.length = length
        self.width = width
        self.height = height
        self.thickness = thickness
        self.leg_size = leg_size
        self.top = self.get_table_top()
    
    def get_table_top(self):
        return Box(self.length, self.width, self.thickness, Frame([0,0,self.height], [1,0,0], [0,1,0]))

    def get_leg_pts(self):
        copybox = Box(self.length - self.leg_size, self.width - self.leg_size, self.thickness, self.top.frame)
        return copybox.points[:4]
    
    def get_table_legs(self):
        legs = []
        for pt in self.get_leg_pts():
            T = Translation.from_vector([0, 0, -pt.z/2])
            frames_in_pt = Frame(pt, [1,0,0], [0,1,0])
            leg = Box(self.leg_size, self.leg_size, self.height - self.thickness/2, frames_in_pt)
            legs.append(leg.transformed(T))
        return legs

    def make_hole(self, cutter):
        return Brep.from_boolean_difference(self.top.to_brep(), cutter.to_brep())
  

table = Table(50, 30, 10, 5)

geom = table.top
geom_2 = table.get_table_legs()


from compas_rhino.conversions import plane_to_compas_frame
 
cuttr = Sphere(radius, plane_to_compas_frame(pl))

geom = table.make_hole(cuttr)

print(geom)
# ---------- end python_3_script ----------
compas_draw = COMPASDraw(cg=python_3_script.geom)  # -> rg
#   port cg: The COMPAS geometry or datastructure to be drawn.
#   port rg: The Rhino geometry object.
# ---------- compas_draw: Python ----------
# r: compas>=2.14.1
"""
Draws COMPAS geometry in Grasshopper.
"""

from typing import Any

import Grasshopper

from compas.scene import SceneObject


class CompasToRhinoGeometry(Grasshopper.Kernel.GH_ScriptInstance):
    def RunScript(self, cg):
        if not cg:
            return None

        return SceneObject(item=cg).draw()
# ---------- end compas_draw ----------
compas_draw_2 = COMPASDraw(cg=python_3_script.geom_2)  # -> rg; same code as compas_draw
