# Grasshopper definition brick_wall.gh (Grasshopper 1.0.8)

number_of_columns = Slider(14, range=1..20)
brick_z_dimension = Slider(0.6, range=0.01..2)
number_of_rows = Slider(13, range=1..20)
rotation_factor = Slider(4.95, range=-10..10)
brick_x_dimension = Slider(2, range=0.01..2)
brick_y_dimension = Slider(1, range=0.01..2)
attractor_point = Point(Point(6.80958659, -3.712929769, 0.1231497297))
python_3_script = Python3Script(
    xsize=brick_x_dimension,
    ysize=brick_y_dimension,
    zsize=brick_z_dimension,
    row_count=number_of_rows,
    column_count=number_of_columns,
    rotation_factor=rotation_factor,
    attractor_point=attractor_point)  # -> brick_wall; inputs xsize: Double, ysize: Double, zsize: Double, row_count: Int32, column_count: Int32, attractor_point: Point3d
# ---------- python_3_script: Python ----------
# r: compas
# venv: mas-2526

# 0. Import everything we will need
# ... your code here ...

# 1. Start with an empty list of bricks to be created
#    make sure to match the name of this list to the output of this component!
# ... your code here ...

# 2. Create two for loops, one nested inside the other,
#    to iterate over the range of row_count and column_count
# ... your code here ...

        # 3. If the row is odd, calculate an offset of half the size in X
        # ... your code here ...

        # 4. Define the variables x, y, z based on the current column, row
        #    and the inputs for sizes, mortar gaps and offset
        # ... your code here ...

        # 5. Create instance of boxes for each brikc
        #    checking the criteria for half bricks and
        #    correcting size and the location accordingly
        #    There are 3 cases:
        #      1. half-brick if it's an even row and it's the first column
        #      2. half-brick if it's an odd row and it's the last column
        #      3. else, it's a full brick
        # ... your code here ...

        # 6. Move brick to the correct location
        # ... your code here ...
        
        # 7. Rotate brick based on some logic of your choice
        #     For example, calculate the distance from the center point of the brick (x, y, z)
        #     to a reference point (either hard-coded here or referenced adding an input parameter)
        #     Hint: the formula for distance requires using square root, in python `math.sqrt`
        #           and it is as follows:
        #           math.sqrt((x2 - x1)**2 + (y2 - y1)**2 + (z2 - z1)**2)
        #     Hint 2: you could also use the `distance_point_point` function of COMPAS instead
        # ... your code here ...

        # 8. Append the brick to the output list
        # ... your code here ...
# ---------- end python_3_script ----------
compas_draw = COMPASDraw(cg=python_3_script)  # -> rg
#   port cg: The COMPAS geometry or datastructure to be drawn.
#   port rg: The Rhino geometry object.
# ---------- compas_draw: Python ----------
# r: compas>=2.14.1
"""
Draws COMPAS geometry in Grasshopper.
"""

from typing import Any

import Grasshopper

from compas.scene import SceneObject


class CompasToRhinoGeometry(Grasshopper.Kernel.GH_ScriptInstance):
    def RunScript(self, cg):
        if not cg:
            return None

        return SceneObject(item=cg).draw()
# ---------- end compas_draw ----------
preview = CustomPreview(
    Geometry=compas_draw,
    Material={diffuse=RGB(197, 130, 64), emission=RGB(68, 53, 68), shine=0.5, specular=RGB(255, 254, 254), transparency=0})
