# Grasshopper definition brick_wall_solution.ghx (Grasshopper 1.0.8)

# ---- group: This is needed only ONCE in the GH definition
enable_auto_reload = Python3Script()  # -> ok
# ---------- enable_auto_reload: Python ----------
"""
------------------------------
Using VS Code as Python editor
------------------------------

The simplest way to start using VS Code as our editor, is
to place our Python code in files located IN THE SAME FOLDER as our Grasshopper file.

After we have done that, we need 2 steps: 

1. Enable the COMPAS reloader on one component. This tells Grasshopper to watch for changes in the Pythoh files and reload if changed.
2. Every other component that uses Python code from external files needs to start with a method to ensure Grasshopper knows where to load the files from.

"""
# r: compas
# venv: mas-2526

from compas_rhino.devtools import DevTools
DevTools.enable_reloader()
# ---------- end enable_auto_reload ----------

# ----
point = Point(Point(8.869995559, -9.599643743, 3.726407677))
brick_wall = Python3Script(
    x=Slider(3.6, range=0.1..10),
    y=Slider(2.2, range=0.1..10),
    z=Slider(1.2, range=0.1..10),
    rows=Slider(10, range=0..30),
    cols=Slider(16, range=0..30),
    mortar_gap_x=Slider(0.53, range=0..2),
    mortar_gap_z=Slider(0.05, range=0..2),
    attractor=point)  # -> bricks, a; inputs rows: Int32, cols: Int32, attractor: Point3d
# ---------- brick_wall: Python ----------
# r: compas
# venv: mas-2526
from compas_rhino.devtools import DevTools
DevTools.ensure_path()

# 0. Import everything we will need
import math
from compas.geometry import Box
from compas.geometry import Point
from compas_rhino.conversions import point_to_compas

# ..also import our module "brick_wall.py", that needs to be in the same folder as our GH file
from brick_wall import Brick

attractor = point_to_compas(attractor)

# 1. Start with an empty list of bricks to be created
#    make sure to match the name of this list to the output of this component!
bricks = []

# 2. Create two for loops, one nested inside the other,
#    to iterate over the range of rows and columns
for row in range(rows):
    for col in range(cols):
        # 3. If the row is even, calculate an offset of half the size in X
        if row % 2 == 0:
            offset = x / 2
        else:
            offset = 0

        # 4. Define the variables px, py, pz (point position in space) 
        #    based on the current column, row and the inputs for brick dimensions,
        #    mortar gap and offset
        px = (col * (x + mortar_gap_x)) + offset
        py = 0
        pz = row * (z + mortar_gap_z)

        # 5. Create an instance of Point as the center of our brick
        point = Point(px, py, pz)

        # 6. Create an instance of our Brick class
        # [TODO: in order to handle half-bricks, calculate x size  and correct px accordingly]
        brick = Brick(x, y, z, point)

        # 7. Rotate brick based on some logic of your choice
        #     For example, calculate the distance from the center point of the brick (x, y, z)
        #     to a the attractor point
        distance = attractor.distance_to_point(point)
        brick.rotate(distance)

        # 8. Append the brick's drawn geometry to the output list
        brick_geo = brick.draw()
        bricks.append(brick_geo)
# ---------- end brick_wall ----------
compas_draw = COMPASDraw(cg=brick_wall.bricks)  # -> rg
#   port cg: The COMPAS geometry or datastructure to be drawn.
#   port rg: The Rhino geometry object.
# ---------- compas_draw: Python ----------
# r: compas>=2.14.1
"""
Draws COMPAS geometry in Grasshopper.
"""

from typing import Any

import Grasshopper

from compas.scene import SceneObject


class CompasToRhinoGeometry(Grasshopper.Kernel.GH_ScriptInstance):
    def RunScript(self, cg):
        if not cg:
            return None

        return SceneObject(item=cg).draw()
# ---------- end compas_draw ----------
preview = CustomPreview(
    Geometry=compas_draw,
    Material={diffuse=RGB(197, 130, 64), emission=RGB(68, 53, 68), shine=0.5, specular=RGB(255, 254, 254), transparency=0})
