# Grasshopper definition using-vscode_hs25.gh (Grasshopper 1.0.8)

# ---- group: This is needed only ONCE in the GH definition
enable_auto_reload = Python3Script()  # -> ok
# ---------- enable_auto_reload: Python ----------
"""
------------------------------
Using VS Code as Python editor
------------------------------

The simplest way to start using VS Code as our editor, is
to place our Python code in files located IN THE SAME FOLDER as our Grasshopper file.

After we have done that, we need 2 steps: 

1. Enable the COMPAS reloader on one component. This tells Grasshopper to watch for changes in the Pythoh files and reload if changed.
2. Every other component that uses Python code from external files needs to start with a method to ensure Grasshopper knows where to load the files from.

"""
# r: compas
# venv: mas-2526

from compas_rhino.devtools import DevTools
DevTools.enable_reloader()
# ---------- end enable_auto_reload ----------

# ----
example_script = Python3Script()  # -> out
# ---------- example_script: Python ----------
"""
Scripts that use Python code located in external files
need to start with a call to DevTools.ensure_path()

Without this, on some platforms, Grasshopper will not know
where to find the file.
"""
# r: compas
# venv: mas-2526
from compas_rhino.devtools import DevTools
DevTools.ensure_path()

# Below here we write our program, and we can import functions and classes
# from any file in the same folder as this Grasshopper file.

from unicorns import Unicorn

a = Unicorn("Amelie", "pink", 1000)
print(a)
# ---------- end example_script ----------
panel = Panel(example_script)
